# Grasshopper definition brail.gh (Grasshopper 1.0.8)
# plug-ins: RhinoCodePluginGH

in_put_text = Panel("Hat")
number_slider = Slider(1, range=0..1)
txt = Text(in_put_text)
len = TextLength(Text=txt)
range = Range(Domain=len, Steps=len)
subtraction = Subtraction(A=range, B=number_slider)
split = SplitList(List=subtraction, Index=number_slider)  # -> ListA, ListB
rev = ReverseList(List=split.ListB)
chars = Characters(Text=txt)  # -> Result, Unicode
rev_2 = ReverseList(List=chars.Result)
py3 = Python3Script(x=len, i=rev, a=rev_2)  # -> out, r, b, c
# ---------- py3: Python ----------
r=''
c=False


if a.isupper():
    c=True
    r='^'
    b= x-i
if a.isdigit():
    c=True
    r='#'
    b= x-i
# ---------- end py3 ----------

# ---- group: Formating
max_columbs = Slider(17, range=0..250)
hight_between_letters = Slider(11, range=1..42)
distance_between_leters = Slider(8, range=0..10)

# ----
cset = CreateSet(List=py3.b)  # -> Set, Map
dispatch = Dispatch(List=py3.r, DispatchPattern=py3.c)  # -> ListA, ListB
ins = InsertItems(List=rev_2, Item=dispatch.ListA, Indices=cset.Set, Wrap=True)  # -> reverse(simplify(flatten(List)))
join = TextJoin(Text=ins)
len_2 = TextLength(Text=join)
py3_2 = Python3Script(x=max_columbs, y=len_2)  # -> out, a
# ---------- py3_2: Python ----------
if y < x:
    a=y
else:
    a=x
# ---------- end py3_2 ----------

# ---- group: TRANSLATE TEXT BASED ON TABLE
path = FilePath("C:\Users\PoPoA\Desktop\brail\brailLib.txt")
file = ReadFile(File=path, PerLineParse=True)
join_2 = TextJoin(Text=file)
lng = ListLength(List=file)
py3_3 = Python3Script(a=join_2, b=ins, B_len=lng, T_len=len_2)  # -> out, c1, c2, c3, c4, c5, c6
# ---------- py3_3: Python ----------
"""Grasshopper Script"""
br=a.split('\\')
#print(br[3][0])
#print(br[2][2:])
c1=0
c2=0
c3=0
c4=0
c5=0
c6=0
for i in range(B_len):
    x=br[i][0]
    if b == x:
        j=br[i][2:]
        c1=j[2]
        c2=j[4]
        c3=j[8]
        c4=j[10]
        c5=j[14]
        c6=j[16]
        print(j)
# ---------- end py3_3 ----------
entwine = Entwine(
    Branch00=py3_3.c5,
    Branch01=py3_3.c6,
    Branch02=py3_3.c3,
    Branch03=py3_3.c4,
    Branch04=py3_3.c1,
    Branch05=py3_3.c2,
    FlattenInputs=True)
dot_radius = Slider(0.75, range=0..1)
multiplication = Multiplication(A=entwine, B=dot_radius)
flip = FlipMatrix(Data=multiplication)

# ----
Y = UnitY(Factor=1)
pl = PlaneNormal(Origin=Point(0, 0, 0), ZAxis=Y)

# ---- group: CHAR GEOMETRY
space_between_dots = Slider(2.5, range=0..10)
dot_columbs = Slider(3, range=0..10)
dot_rows = Slider(2, range=0..10)
rectangle = Rectangle(Plane=PlaneXY(0, 0, 0), XSize=space_between_dots, YSize=space_between_dots, Radius=0)  # -> Rectangle, Length
arrrec = RectangularArray(Cell=rectangle.Rectangle, XCount=dot_rows, YCount=dot_columbs)  # -> Geometry, Transform

# ----
integer_division = IntegerDivision(A=len_2, B=py3_2.a)
rectangle_2 = Rectangle(Plane=PlaneXY(0, 0, 0), XSize=distance_between_leters, YSize=hight_between_letters, Radius=0)  # -> Rectangle, Length
mod = Modulus(A=len_2, B=py3_2.a)
subtraction_2 = Subtraction(A=integer_division)
number_slider_2 = Slider(2, range=0..10)
mirror = Mirror(Geometry=rectangle_2.Rectangle, Plane=pl)  # -> Geometry, Transform
and = GateAnd(A=Slider(1, range=0..1), B=mod)
addition = Addition(A=subtraction_2, B=and)
multiplication_2 = Multiplication(A=hight_between_letters, B=addition)
X = UnitX(Factor=1)
arrrec_2 = RectangularArray(Cell=mirror.Geometry, XCount=py3_2.a, YCount=addition)  # -> Geometry, Transform
subtraction_3 = Subtraction(A=multiplication_2, B=hight_between_letters)
split_2 = SplitList(List=arrrec_2.Transform, Index=len_2)  # -> ListA, ListB
division = Division(A=hight_between_letters, B=number_slider_2)
division_2 = Division(A=distance_between_leters, B=number_slider_2)
subtraction_4 = Subtraction(A=subtraction_3)
flip_2 = FlipMatrix(Data=split_2.ListA)
multiplication_3 = Multiplication(A=division_2, B=X)
sph = Sphere(Base=arrrec.Transform, Radius=flip)
division_3 = Division(A=division, B=number_slider_2)
subtraction_5 = Subtraction(A=division, B=hight_between_letters)
multiplication_4 = Multiplication(A=distance_between_leters, B=py3_2.a)
vec = VectorXYZ(XComponent=multiplication_3, YComponent=subtraction_4, ZComponent=0)  # -> Vector, Length
addition_2 = Addition(A=subtraction_5, B=division_3)
move = Move(Geometry=sph, Motion=flip_2)  # -> Geometry, Transform
addition_3 = Addition(A=multiplication_4, B=division_2)
multiplication_5 = Multiplication(A=hight_between_letters, B=integer_division)
vec_2 = VectorXYZ(XComponent=0, YComponent=addition_2, ZComponent=0)  # -> Vector, Length

# ---- group: box
Z = UnitZ(Factor=1)
thicness = Slider(1, range=0..100)
Y_2 = UnitY(Factor=1)
X_2 = UnitX(Factor=1)
rev_3 = Reverse(Vector=Z)
pl_2 = ConstructPlane(Origin=Point(0, 0, 0), XAxis=X_2, YAxis=Y_2)
box = DomainBox(Base=pl_2, X=addition_3, Y=multiplication_2, Z=thicness)
multiplication_6 = Multiplication(A=thicness, B=rev_3)
move_2 = Move(Geometry=box, Motion=multiplication_6)  # -> Geometry, Transform

# ----
move_3 = Move(Geometry=move.Geometry, Motion=vec.Vector)  # -> Geometry, Transform
move_4 = Move(Geometry=move_2.Geometry, Motion=vec_2.Vector)  # -> Geometry, Transform
